# Grasshopper definition trees_optimalization.gh (Grasshopper 1.0.7)
# plug-ins: TT Toolbox

read = BooleanToggle(True)
file_path = FilePath("D:\prokuratura\inwentaryzacja zieleni\Zalacznik_nr17_11z12_Inwentaryzacja_dendrologicznatabela_inwentaryzacyjna.xlsx")

# ---- group: inputs trees at the plot
number = Number([1, 2, 3, 4, 5, 6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])
point = Point([Point(6568801.801, 5571095.017, 0), Point(6568792.255, 5571103.719, 0), Point(6568795.405, 5571107.957, 0), Point(6568797.947, 5571106.54, 0), Point(6568793.962, 5571120.291, 0), Point(6568799.536, 5571122.017, 0)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])
sort_list = SortList(Keys=number, ValuesValuesA=point)  # -> Keys, ValuesValuesA
circle_cnr = CircleCNR(Center=point, Normal=Vector(0, 0, 1), Radius="1")
point_2 = Point(simplify(sort_list.ValuesValuesA))

# ---- group: Read Excel
listen = BooleanToggle(False)
read_excel_sheet = ReadExcelSheet(Run=read, FilePath=file_path, Worksheet="1", Listen=listen)  # -> UserMessages, Columns, Rows

# ---- group: Correct Excel
panel = Panel("""1
2
7""")
tree_branch = TreeBranch(Tree=read_excel_sheet.Columns, Path=panel, MaintainPaths=True)
panel_2 = Panel("""0
1""")
series = Series(Start="1155", Step=1, Count="21")
cull_index = CullIndex(List=tree_branch, Indices=panel_2, Wrap=True)  # -> simplify(List)
cull_index_2 = CullIndex(List=cull_index, Indices=series, Wrap=True)  # -> simplify(List)
explode_tree = ExplodeTree(Data=cull_index_2)  # -> Branch0, Branch1, Branch2
match_text = MatchText(Text=explode_tree.Branch1, RegEx="F", Case=True)
match_text_2 = MatchText(Text=explode_tree.Branch1, RegEx="D", Case=True)
match_text_3 = MatchText(Text=explode_tree.Branch1, RegEx="E", Case=True)
match_text_4 = MatchText(Text=explode_tree.Branch1, RegEx="C", Case=True)
match_text_5 = MatchText(Text=explode_tree.Branch1, RegEx="B", Case=True)
addition = Addition(A=match_text_5, B=match_text_4, C=match_text_2, D=match_text_3, E=match_text)
dispatch = Dispatch(List=explode_tree.Branch2, DispatchPattern=addition)  # -> flatten(ListA), flatten(ListB)

# ---- group: Visualization of all trees
# Dead
panel_3 = Panel("zamiera")
# Medium
match_text_6 = MatchText(Text=dispatch.ListB, Pattern="średni", Case=True)
# Good
match_text_7 = MatchText(Text=dispatch.ListB, Pattern="dobry", Case=True)
# Wither
match_text_8 = MatchText(Text=dispatch.ListB, Pattern=panel_3, Case=True)
# Bad
match_text_9 = MatchText(Text=dispatch.ListB, Pattern="zły", Case=True)
match_text_10 = MatchText(Text=dispatch.ListB, Pattern="martwy", Case=True)
dispatch_2 = Dispatch(List=point_2, DispatchPattern=match_text_6)  # -> ListA, ListB
dispatch_3 = Dispatch(List=point_2, DispatchPattern=match_text_7)  # -> ListA, ListB
dispatch_4 = Dispatch(List=point_2, DispatchPattern=match_text_9)  # -> ListA, ListB
dispatch_5 = Dispatch(List=point_2, DispatchPattern=match_text_10)  # -> ListA, ListB
dispatch_6 = Dispatch(List=point_2, DispatchPattern=match_text_8)  # -> ListA, ListB
point_3 = Point(dispatch_2.ListA)
point_4 = Point(dispatch_3.ListA)
point_5 = Point(dispatch_4.ListA)
point_6 = Point(dispatch_6.ListA)
point_7 = Point(dispatch_5.ListA)
dot_display = DotDisplay(Point=point_3, Colour=ColourSwatch(SwatchColor=RGB(255, 175, 88)), Size=Slider(2, range=1..10))
dot_display_2 = DotDisplay(Point=point_4, Colour=ColourSwatch(SwatchColor=RGB(142, 245, 47)), Size=Slider(2, range=1..10))
dot_display_3 = DotDisplay(Point=point_7, Colour=ColourSwatch(SwatchColor=RGB(180, 65, 74)), Size=Slider(2, range=1..10))
dot_display_4 = DotDisplay(Point=point, Colour=ColourSwatch(SwatchColor=RGB(0, 0, 0)), Size=Slider(1, range=1..10))
dot_display_5 = DotDisplay(Point=point_5, Colour=ColourSwatch(SwatchColor=RGB(198, 139, 29)), Size=Slider(2, range=1..10))
dot_display_6 = DotDisplay(Point=point_6, Colour=ColourSwatch(SwatchColor=RGB(226, 98, 16)), Size=Slider(2, range=1..10))

# ---- group: inputs
number_slider = Slider(0.01, range=0..0.5)
number_slider_2 = Slider(0.62, range=0.2..0.8)
number_slider_3 = Slider(73, range=60..100)
curve = Curve(<curve referenced from the Rhino model>)
curve_2 = Curve(<curve referenced from the Rhino model>)

# ---- group: Generative design for finding the best boundry fot the building
bounding_box = BoundingBox(Content=curve_2, Plane=PlaneXY(0, 0, 0))  # -> Box, Box_2
evaluate_box = EvaluateBox(Box=bounding_box.Box_2, UParameter=number_slider_2, VParameter=number_slider, WParameter=0.5)  # -> Plane, Point, Include
point_8 = Point(evaluate_box.Point)
division = Division(A="6000", B=number_slider_3)
plane = Plane(point_8)
rectangle = Rectangle(Plane=plane, XSize=number_slider_3, YSize=division, Radius=0)  # -> Rectangle, Length
# Dead
point_in_curve = PointInCurve(Point=point_4, Curve=rectangle.Rectangle)  # -> Relationship, Point
point_in_curve_2 = PointInCurve(Point=point_3, Curve=rectangle.Rectangle)  # -> Relationship, Point
point_in_curve_3 = PointInCurve(Point=point_5, Curve=rectangle.Rectangle)  # -> Relationship, Point
point_in_curve_4 = PointInCurve(Point=point_6, Curve=rectangle.Rectangle)  # -> Relationship, Point
point_in_curve_5 = PointInCurve(Point=point_7, Curve=rectangle.Rectangle)  # -> Relationship, Point
point_in_curve_6 = PointInCurve(Point=point_2, Curve=rectangle.Rectangle)  # -> Relationship, Point
explode = Explode(Curve=rectangle.Rectangle, Recursive=True)  # -> Segments, Vertices
cull_pattern = CullPattern(List=point_4, CullPattern=point_in_curve.Relationship)
cull_pattern_2 = CullPattern(List=point_3, CullPattern=point_in_curve_2.Relationship)
cull_pattern_3 = CullPattern(List=point_5, CullPattern=point_in_curve_3.Relationship)
cull_pattern_4 = CullPattern(List=point_6, CullPattern=point_in_curve_4.Relationship)
cull_pattern_5 = CullPattern(List=point_7, CullPattern=point_in_curve_5.Relationship)
cull_pattern_6 = CullPattern(List=point_2, CullPattern=point_in_curve_6.Relationship)
point_in_curve_7 = PointInCurve(Point=explode.Vertices, Curve=curve_2)  # -> Relationship, Point
list_length = ListLength(List=cull_pattern)
list_length_2 = ListLength(List=cull_pattern_2)
list_length_3 = ListLength(List=cull_pattern_3)
list_length_4 = ListLength(List=cull_pattern_4)
list_length_5 = ListLength(List=cull_pattern_5)
list_length_6 = ListLength(List=cull_pattern_6)
number_2 = Number(list_length_6)
cull_pattern_7 = CullPattern(List=explode.Vertices, CullPattern=point_in_curve_7.Relationship)
list_length_7 = ListLength(List=cull_pattern_7)
multiplication = Multiplication(A=list_length_5, B=Slider(3, range=1..3))
multiplication_2 = Multiplication(A=list_length_3, B=Slider(2, range=1..3))
multiplication_3 = Multiplication(A=list_length_4, B=Slider(2.5, range=1..3))
equality = Equality(FirstNumber=list_length_7, SecondNumber="5")  # -> Equality, Inequality
subtraction = Subtraction(A=number_2, B=multiplication, C=multiplication_3, D=multiplication_2)
list_length_8 = ListLength(List=point)
number_3 = Number(equality.Equality)
c_script = CSharpScript(number=subtraction)  # -> out, A; inputs number: Int32
# ---------- c_script: C# ----------
    if (number > 0)
    {

      number += 1;

    }

    else

      number = 1;


    A = number;
# ---------- end c_script ----------
division_2 = Division(A=list_length_8, B=c_script.A)
multiplication_4 = Multiplication(A=division_2, B=number_3)  # -> simplify(flatten(Result))
galapagos = Galapagos(fitness=multiplication_4, gene=[number_slider, number_slider_2, number_slider_3])

# ---- group: Condition statistics
# All trees
# Dead
# Wither
# Bad
# Medium
# Good
panel_4 = Panel(list_length_6)
panel_5 = Panel(list_length_5)
panel_6 = Panel(list_length_4)
panel_7 = Panel(list_length_3)
panel_8 = Panel(list_length_2)
panel_9 = Panel(list_length)

# ---- group: Grade text
point_9 = Point(<point referenced from the Rhino model>)
text_join = TextJoin(Text=["Grade = ", multiplication_4])
panel_10 = Panel(text_join)
text_tag_3d = TextTag3D(Location=point_9, Text=text_join, Size="20", Justification=7)
